# Grasshopper definition simple_circle_array.ghx (Grasshopper 1.0.7)

# ---- group: RH_IN:102:0001
pt = Point()

# ---- group: RH_IN:105:0001
num = Number()

# ----
circle = CircleCNR(Center=pt, Normal=Vector(0, 0, 1), Radius=num)
divide = DivideCurve(Curve=circle, Count=10, Kinks=False)  # -> Points, Tangents, Parameters
circle_2 = CircleCNR(Center=divide.Points, Normal=Vector(0, 0, 1), Radius=num)

# ---- group: RH_OUT:109:0001
circle_3 = Circle(circle)

# ---- group: RH_OUT:109:0002
circle_4 = Circle(circle_2)
