# Grasshopper definition simple_circle_one.ghx (Grasshopper 1.0.7)

# ---- group: RH_IN:102:0001
pt = Point()

# ---- group: RH_IN:105:0001
num = Number()

# ----
circle = CircleCNR(Center=pt, Normal=Vector(0, 0, 1), Radius=num)

# ---- group: RH_OUT:109:0001
circle_2 = Circle(circle)
