# Grasshopper definition simple_circle_one_debug.ghx (Grasshopper 1.0.7)
# plug-ins: ResthopperGH

pt = ConstructPoint(XCoordinate=0, YCoordinate=0, ZCoordinate=0)

# ---- group: RH_IN:102:0001
pt_2 = Point()

# ---- group: RH_IN:105:0001
num = Number()

# ---- group: RH_IN:102:0001
pt_3 = Point(pt)

# ---- group: RH_IN:105:0001
num_2 = Number(Slider(100, range=0..100))

# ----
# C:\Users\David Mans\Documents\GitHub\compute.rhino3d\src\compute.geometry\definitions\sample\simple_circle_array.ghx
circle = CircleCNR(Center=pt_2, Normal=Vector(0, 0, 1), Radius=num)
rh_input = RHInput(GHInput=num_2)
rh_input_2 = RHInput(GHInput=pt_3)
rh_serializer = RHSerializer(Inputs=[rh_input_2, rh_input])  # -> Schema, Json
copy_to_clipboard = CopyToClipboard(Text=rh_serializer.Json)

# ---- group: RH_OUT:109:0001
circle_2 = Circle(circle)

# ----
panel = Panel(rh_serializer.Json)
