# Grasshopper definition Hops_Example.gh (Grasshopper 1.0.7)
# plug-ins: Hops

number_slider = Slider(33, range=0..100)
cir = Circle(Plane=PlaneXY(0, 0, 0), Radius=Slider(3.6, range=0..10))
hops = Hops(
    Curve=cir,
    T=Slider(12.4, range=0..50),
    CacheSolveResults=True,
    RemoteDefinitionLocation="http://localhost:5000/pointat",
    RemoteSolveVersion=(0, 1, 0))

# ---- group: Should Return Erro with Stack Trace
hops_2 = Hops(
    A=number_slider,
    B=number_slider,
    CacheSolveResults=True,
    RemoteDefinitionLocation="http://localhost:5000/add",
    RemoteSolveVersion=(0, 1, 0))

# ----
pt = Point(Point(11.03548885, -0.9967538318, 0))
pt_2 = Point(Point(0.6407703204, 9.587822572, 0))
pt_3 = Point(Point(8.424943102, 7.214599163, 0))
panel = Panel(hops_2)

# ---- group: Only Works in Rhino.Inside CPython
point = Point(Point(-7.804894823, -1.770079228, 0))
point_2 = Point(Point(9.420417946, 4.496643015, 0))
point_3 = Point(Point(28.16384341, 5.641393124, 0))
hops_3 = Hops(
    P1=hops,
    P2=point_2,
    P3=point_3,
    CacheSolveResults=True,
    RemoteDefinitionLocation="http://localhost:5000/interplength",
    RemoteSolveVersion=(0, 1, 0))
panel_2 = Panel(hops_3)

# ----
hops_4 = Hops(
    CornerA=hops,
    CornerB=pt,
    CornerC=pt_2,
    CornerD=pt_3,
    CacheSolveResults=True,
    RemoteDefinitionLocation="http://localhost:5000/srf4pt",
    RemoteSolveVersion=(0, 1, 0))
panel_3 = Panel(hops_4)
