# Grasshopper definition hops_pythonserver_test.gh (Grasshopper 1.0.7)
# plug-ins: Hops

number_slider = Slider(34, range=0..100)
cir = Circle(Plane=PlaneXY(0, 0, 0), Radius=Slider(3.6, range=0..10))
hops = Hops(
    Curve=cir,
    T=Slider(27.1, range=0..50),
    CacheSolveResults=True,
    RemoteDefinitionLocation="http://localhost:5000/pointat",
    RemoteSolveVersion=(0, 1, 0))

# ---- group: Should Return Erro with Stack Trace
hops_2 = Hops(
    A=number_slider,
    B=number_slider,
    CacheSolveResults=True,
    RemoteDefinitionLocation="http://localhost:5000/add",
    RemoteSolveVersion=(0, 1, 0))

# ----
pt = Point(Point(11.03548885, -0.9967538318, 0))
pt_2 = Point(Point(0.6407703204, 9.587822572, 0))
pt_3 = Point(Point(8.424943102, 7.214599163, 0))
panel = Panel(hops_2)
hops_3 = Hops(
    CornerA=hops,
    CornerB=pt,
    CornerC=pt_2,
    CornerD=pt_3,
    CacheSolveResults=True,
    RemoteDefinitionLocation="http://localhost:5000/srf4pt",
    RemoteSolveVersion=(0, 1, 0))
panel_2 = Panel(hops_3)
